% Simulink data dictionary EstimatorsDictionary.sldd
% references CellDictionary.sldd

Ts = Simulink.Parameter(1)
soc_estim_init = Simulink.Parameter(0.5)
initial_covariance = Simulink.Parameter([0.2 1.0e-6 1.0e-5 0.0001])
state_covariance = Simulink.Parameter([1.0e-10 0 0 0; 0 1.0e-8 0 0; 0 0 1.0e-8 0; 0 0 0 1.0e-8])
measurement_covariance = Simulink.Parameter(0.0001)